# Grasshopper definition Isovist.gh (Grasshopper 1.0.7)

number_slider = Slider(100, range=0..100)
number_slider_2 = Slider(387, range=0..1000)
circle = Circle({Plane=Plane(origin=(8, 220, 0), x=(0, 1, 0), y=(-1, 0, 0)), Radius=142})
rectangle = Rectangle({Plane=PlaneXY(5, 278, 0), Size=Domain2(u=-20..20, v=-22..22)})
point = Point(Point(65.25792031, 233.2712998, 0))
point_2 = Point(Point(-18.17946261, -2.700476092, 0))
deconstruct_brep = DeconstructBrep()  # -> Faces, Edges, Vertices
ghpython_script = GhPythonScript(boundary=circle, obstacle=rectangle, origin=point)  # -> out, obstacle_points, raycasting, boundary_points; inputs boundary: Curve, obstacle: Curve, origin: Point3d
# ---------- ghpython_script: Python ----------
import Rhino.Geometry as rg
import rhinoscriptsyntax as rs
import ghpythonlib.components as gh

obstacle_points = rs.CurvePoints(obstacle)
boundary_points = rs.DivideCurve(boundary, 50)
raycasting = []

for i in range(len(obstacle_points)):
    line = rs.AddLine(origin, obstacle_points[i])
    raycasting.append(line)

#rg.Line(
# ---------- end ghpython_script ----------
ghpython_script_2 = GhPythonScript(origin=point_2, radius=number_slider_2, count=number_slider)  # -> out, origin, recs; inputs origin: Point3d
# ---------- ghpython_script_2: Python ----------
import Rhino.Geometry as rg
import rhinoscriptsyntax as rs
import ghpythonlib.components as gh

w = 20

recs = []
for i in range(11):
    for j in range(11):
        rec = rs.AddRectangle([i*w*3-300,j*w*3-300,0], w, w)
        recs.append(rec)

circle = rs.AddCircle(origin, radius)
points = rs.DivideCurve(circle, count)

lns = []
for i in range(len(points)):
    ln = rs.AddLine(origin, points[i])
    lns.append(ln)
# ---------- end ghpython_script_2 ----------
line = Line(StartPoint=point, EndPoint=deconstruct_brep.Vertices)
isovist = IsoVist(Plane=point_2, Count=number_slider, Radius=number_slider_2, Obstacles=ghpython_script_2.recs)  # -> Points, Distance, Index
point_3 = Point(Point(8.300437815, 80.87411587, 0))
point_4 = Point(Point(130.0656383, 118, 0))
point_5 = Point(Point(110.653723, -39.55982144, 0))
point_6 = Point(Point(67.64593301, 169.8993144, 0))
ghpython_script_3 = GhPythonScript(p1=point_3, p2=point_4, p3=point_5, p4=point_6)  # -> out, p, p2; inputs p1: Point3d, p2: Point3d, p3: Point3d, p4: Point3d
# ---------- ghpython_script_3: Python ----------
import Rhino.Geometry as rg
import rhinoscriptsyntax as rs
import ghpythonlib.components as gh



print(p1[0] - p2[0])
print(p3[1] - p4[1])

d1 = (p1[0] - p2[0]) * (p3[1] - p4[1])
d2 = (p1[1] - p2[1]) * (p3[0] - p4[0])
d = d1 - d2

print(d)

u1 = (p1[0] * p2[1] - p1[1] * p2[0])
u4 = (p3[0] * p4[1] - p3[1] * p4[0])

print(u1)
print(u4)

u2x = p3[0] - p4[0]
u3x = p1[0] - p2[0]
u2y = p3[1] - p4[1]
u3y = p1[1] - p2[1]

px = (u1 * u2x - u3x * u4) / d
py = (u1 * u2y - u3y * u4) / d

p = rs.AddPoint(px, py, 0)
# ---------- end ghpython_script_3 ----------
line_2 = Line(StartPoint=point_2, EndPoint=isovist.Points)
ghpython_script_4 = GhPythonScript(p1=point_3, p2=point_4, p3=point_5, p4=point_6)  # -> out, a, b; inputs p1: Point3d, p2: Point3d, p3: Point3d, p4: Point3d
# ---------- ghpython_script_4: Python ----------
import rhinoscriptsyntax as rs

# 선분1 ; (x11,y11) to (x12, y12)
# 선분2 ; (x21,y21) to (x22, y22)
x11 = p1[0]; y11 = p1[1]
x12 = p2[0]; y12 = p2[1]
x21 = p3[0]; y21 = p3[1]
x22 = p4[0]; y22 = p4[1]

# 선분1의 기울기 => m1; 선분2의 기울기 => m2
m1 = (y11-y12) / (x11-x12)
m2 = (y21-y22) / (x21-x22)

cx = (x11*m1 - x21*m2 - y11+y21) / (m1 - m2)
cy = m1*(cx-x11) + y11

# 선분1과 선분2의 교차 여부 판단
f1 = y21- (m1*x21 - m1*x11 + y11 )
f2 = y22 - (m1*x22 - m1*x11 + y11 )

if f1*f2 < 0:
    a = rs.AddPoint(cx, cy, 0)
# ---------- end ghpython_script_4 ----------
line_3 = Line(StartPoint=point_3, EndPoint=point_4)
line_4 = Line(StartPoint=point_5, EndPoint=point_6)
