# Grasshopper definition p201.gh (Grasshopper 1.0.7)

md_slider = MDSlider(
    SliderMode=0,
    slider_value=Point(0.4994958731, 0.4995092105, 0.5),
    x_domain=Domain(0, 1),
    y_domain=Domain(0, 1),
    z_domain=Domain(0, 1))
ghpython_script = GhPythonScript(slider=md_slider, angle_min=Slider(0, range=0..1000), angle_max=Slider(61.42, range=0..1000))  # -> out, datumn_point, grid_segmented, axis_line, angle_list; inputs slider: Point3d
# ---------- ghpython_script: Python ----------
import math
import Rhino.Geometry as rg
import rhinoscriptsyntax as rs
import ghpythonlib.components as gh

class Triangrid:
    def __init__(self, plane, size, x_count, y_count):
        self.plane = plane
        self.size = size
        self.x_count = x_count
        self.y_count = y_count
        self.curves = self.grid_gen()
        
    def get_guid(self, curve):
        guid = rs.MoveObject(curve, [0,0,0])
        return guid
        
    def get_midpoint(self, curve):
        midpoint = rs.CurveMidPoint(curve)
        return midpoint
        
    def get_axis(self, curve):
        axis_line = rs.CurvePoints(curve)
        axis_line = axis_line[0] - axis_line[1]
        return axis_line
        
    def grid_gen(self):
        grid = gh.Triangular(self.plane, self.size, self.x_count, self.y_count)[0]
        return grid
        
    def grid_merge(self):
        union = gh.RegionUnion(self.curves)
        return union
        
    def grid_centroid(self, curve):
        centroid = rs.CurveAreaCentroid(curve)[0]
        return centroid
        
    def grid_scaled(self, curve, origin, factor):
        scaled = gh.Scale(curve, origin, factor)[0]
        return scaled
        
    def grid_segment(self, curve, scaled):
        segmented = rs.AddLoftSrf([curve, scaled])
        return segmented
        
    def grid_deconstruct(self, curve):
        curve_list = gh.DeconstructBrep(curve)[1]
        return curve_list  
        
    def surface_gen(self, curve):
        surface = gh.BoundarySurfaces(curve)
        return surface
        
    def surface_reparam(self):
        base_srf = self.surface_gen(self.grid_merge())
        base_srf = rs.coercesurface(base_srf)
        domain = rg.Interval(0.00, 1.00)
        base_srf.SetDomain(0, domain)
        base_srf.SetDomain(1, domain)
        return base_srf
        
    def surface_eval(self, u, v):
        point = rs.EvaluateSurface(self.surface_reparam(), u, v)
        return point
        
    def surface_centroid(self, surface):
        centroid = rs.SurfaceAreaCentroid(surface)[0]
        return centroid
        
    def surface_rotate(self, surface, origin, angle, axis):
        return rs.RotateObject(surface,  origin, angle, axis)

if __name__ == '__main__':
    SCALE = 0.0001
    PLANE = rg.Plane.WorldXY
#    TARGET_VALUE = 70
    triangles = Triangrid(PLANE, 3, 13, 8)
    datumn_point = triangles.surface_eval(slider[0], slider[1])
    
    grid_segmented = []
    distance_list = []
    axis_line = []
    for triangle in triangles.curves:
        triangle_centroid = triangles.grid_centroid(triangle)
        scaled = triangles.grid_scaled(triangle, triangle_centroid, SCALE)
        
        triangle_line_list = triangles.grid_deconstruct(triangle)
        scaled_line_list = triangles.grid_deconstruct(scaled)
        axis_line.extend([triangle_line_list[0],triangle_line_list[1],triangle_line_list[2]])
        
        for i in range(len(scaled_line_list)):
            segmented = triangles.grid_segment(triangle_line_list[i], scaled_line_list[i])[0]
            segmented_centroid = triangles.surface_centroid(segmented)
            distance = rs.Distance(triangles.get_guid(datumn_point), segmented_centroid)
            
            grid_segmented.append(segmented)
            distance_list.append(distance)
            
    source = rg.Interval(min(distance_list), max(distance_list))
    target = rg.Interval(angle_max, angle_min)
    angle_list = gh.RemapNumbers(distance_list, source, target)[0]
    
    for i, temp_segmented in enumerate(grid_segmented):
        temp_cvrt = rs.coercebrep(temp_segmented)
        temp_line = triangles.grid_deconstruct(temp_cvrt)[3]
        temp_axis = triangles.get_axis(temp_line)
        temp_guid = triangles.get_guid(temp_line)
        temp_midp = triangles.get_midpoint(temp_guid)
        
        triangles.surface_rotate(temp_segmented, temp_midp, angle_list[i], temp_axis)
# ---------- end ghpython_script ----------
triangular = Triangular(Plane=PlaneXY(0, 0, 0), Size=Slider(3, range=0..10), ExtentX=Slider(13, range=0..100), ExtentY=Slider(8, range=0..100))  # -> flatten(Cells), Points
area = Area(Geometry=triangular.Cells)  # -> Area, Centroid
boundary_surfaces = BoundarySurfaces(Edges=triangular.Cells)
region_union = RegionUnion(Curves=triangular.Cells)
md_slider_2 = MDSlider(
    SliderMode=0,
    slider_value=Point(0.4892852367, 0.5493293658, 0.5),
    x_domain=Domain(0, 1),
    y_domain=Domain(0, 1),
    z_domain=Domain(0, 1))
evaluate_surface = EvaluateSurface(Surface=reparameterize(region_union), Point=md_slider_2)  # -> Point, Normal, UDirection, VDirection, Frame
scale = Scale(Geometry=boundary_surfaces, Center=area.Centroid, Factor=Slider(0.0001, range=0..1))  # -> Geometry, Transform
deconstruct_brep = DeconstructBrep(Brep=flatten(boundary_surfaces))  # -> Faces, graft(Edges), Vertices
deconstruct_brep_2 = DeconstructBrep(Brep=flatten(scale.Geometry))  # -> Faces, graft(Edges), Vertices
loft = Loft(
    Curves=[deconstruct_brep.Edges, deconstruct_brep_2.Edges],
    Options={Adjust=False, Closed=False, LoftEnds=0, LoftSimp=0, LoftType=0, Rebuild=10, Refit=0.01})
area_2 = Area(Geometry=loft)  # -> Area, Centroid

# ---- group: rotate degree
construct_domain = ConstructDomain(DomainStart=Slider(57, range=0..720), DomainEnd=Slider(0, range=0..100))

# ----
distance = Distance(PointA=area_2.Centroid, PointB=evaluate_surface.Point)
bounds = Bounds(Numbers=flatten(distance))
remap_numbers = RemapNumbers(Value=distance, Source=bounds, Target=construct_domain)  # -> Mapped, Clipped
rotate_axis = RotateAxis(Geometry=loft, Angle=degrees(remap_numbers.Mapped), Axis=deconstruct_brep.Edges)  # -> Geometry, Transform
