# Grasshopper definition TwoPointMatrix.gh (Grasshopper 1.0.7)

point = Point(Point(-214.2723577, -47.38489723, 0))
point_2 = Point(Point(126.8042778, 395.6019234, 0))
ghpython_script = GhPythonScript(point1=point, point2=point_2, count=Slider(12, range=0..100))  # -> out, matrix; inputs point1: Point3d, point2: Point3d, count: Int32
# ---------- ghpython_script: Python ----------
import sys
import rhinoscriptsyntax as rs

# print(sys.version) 
# 2.7.8 (IronPython 2.7.8 (2.7.8.0) on .NET 4.0.30319.42000 (64-bit)) 

class Point:
    def __init__(self, x, y, z):
        self._x = x
        self._y = y
        self._z = z
        
    def coordinate(self):
        coord_dict = {'x':self._x, 'y':self._y, 'z':self._z}
        
        return coord_dict 
        
    def generate(self):
        x = self.coordinate()['x']
        y = self.coordinate()['y']
        z = self.coordinate()['z']
        pt = rs.AddPoint(x, y, z)
        
        return pt


class Matrix(Point):
    def __init__(self, p1, p2, cnt):
        self._p1 = p1
        self._p2 = p2
        self._cnt = cnt
        self._pts = []
        
    def points(self):
        p1_coord = self._p1.coordinate()
        p2_coord = self._p2.coordinate()
        points_dict = {'p1':p1_coord, 'p2':p2_coord}
        
        return points_dict
        
    def distance(self):
        x_distance = abs(self.points()['p1']['x'] - self.points()['p2']['x'])
        y_distance = abs(self.points()['p1']['y'] - self.points()['p2']['y'])
        distance_dict = {'x':x_distance, 'y':y_distance}
        
        return distance_dict
        
    def interval(self):
        x_interval = self.distance()['x'] / self._cnt
        y_interval = self.distance()['y'] / self._cnt
        interval_dict = {'x':x_interval, 'y':y_interval}
        
        return interval_dict
        
    def grid(self):
        def grid_gen(pos_1, pos_2):
            for i in range(self._cnt+1):
                for j in range(self._cnt+1):
                    x = i*self.interval()['x']+pos_1
                    y = j*self.interval()['y']+pos_2
                    pt = rs.AddPoint(x,y,0)
                    self._pts.append(pt)
                    
        if self.points()['p1']['x'] < self.points()['p2']['x']:
            if self.points()['p1']['y'] < self.points()['p2']['y']:
                grid_gen(self.points()['p1']['x'], self.points()['p1']['y'])
                
            elif self.points()['p1']['y'] > self.points()['p2']['y']:
                grid_gen(self.points()['p1']['x'], self.points()['p2']['y'])
                    
        if self.points()['p1']['x'] > self.points()['p2']['x']:
            if self.points()['p1']['y'] > self.points()['p2']['y']:
                grid_gen(self.points()['p2']['x'], self.points()['p2']['y'])
                
            elif self.points()['p1']['y'] < self.points()['p2']['y']:
                grid_gen(self.points()['p2']['x'], self.points()['p1']['y'])
                
        return self._pts

#pt1 = Point(point1[0],point1[1],point1[2])
#pt2 = Point(point2[0],point2[1],point2[2])
pt1 = Point(-214.272358, -47.384897, 0)
pt2 = Point(126.804278, 395.601923, 0)
matrix = Matrix(pt1,pt2,count)
matrix = matrix.grid()
# ---------- end ghpython_script ----------
