# Grasshopper definition Vector.gh (Grasshopper 1.0.7)

ghpython_script = GhPythonScript()  # -> out, p1, p2, p3, v1, v2, v3
# ---------- ghpython_script: Python ----------
import Rhino.Geometry as rg
import rhinoscriptsyntax as rs
import ghpythonlib.components as gh

p1 = rs.PointCoordinates(rs.AddPoint(0,0,0))
p2 = rs.PointCoordinates(rs.AddPoint(2,4,0))
p3 = rs.PointCoordinates(rs.AddPoint(5,2,0))

v1 = p2-p1
v2 = p3-p2
v3 = p1-p3
print(type(v1))
# ---------- end ghpython_script ----------
vector_display = VectorDisplay(
    Anchor=[ghpython_script.p1, ghpython_script.p2, ghpython_script.p3],
    Vector=[ghpython_script.v1, ghpython_script.v2, ghpython_script.v3])
vector_display_2 = VectorDisplay(Anchor=[ghpython_script.p1, ghpython_script.p2, ghpython_script.p3], Vector=ghpython_script.v1)
vector_display_3 = VectorDisplay(Anchor=[ghpython_script.p1, ghpython_script.p2, ghpython_script.p3], Vector=ghpython_script.v2)
vector_display_4 = VectorDisplay(Anchor=[ghpython_script.p1, ghpython_script.p2, ghpython_script.p3], Vector=ghpython_script.v3)
point_coordinate = Panel([ghpython_script.p1, ghpython_script.p2, ghpython_script.p3])
vector = Panel([ghpython_script.v1, ghpython_script.v2, ghpython_script.v3])
